# Grasshopper definition Faraz tunnel.gh (Grasshopper 1.0.8)
# plug-ins: Rhino.Inside for Autodesk Revit

# ---- group: Inre bredd och vägg tjocklek
vägg_tjocklek = Slider(1000, range=0..1200)
tunnel_inre_bredd = Slider(15000, range=0..32000)
division = Division(A=tunnel_inre_bredd, B=2)
addition = Addition(A=division, B=vägg_tjocklek)

# ---- group: Taklutning och typ
takanslutnings_typ = ValueList({"Bombering": 1, "Normal": 0}, selected="Bombering")
taklutning = Slider(2.5, range=0..7)
panel = Panel(takanslutnings_typ)
division_2 = Division(A=taklutning, B=100)
multiplication = Multiplication(A=addition, B=division_2)
multiplication_2 = Multiplication(A=panel, B=-1)
multiplication_3 = Multiplication(A=multiplication_2, B=multiplication)

# ---- group: Tunnel innerhöjd och tjocklek
tunneltak_tjocklek = Slider(800, range=0..1200)
tunnel_innerhöjd = Slider(8700, range=0..11000)
addition_2 = Addition(A=tunneltak_tjocklek, B=tunnel_innerhöjd)

# ---- group: Bottenplatta
platta_tass_vänster = Slider(1500, range=0..10000)
platta_tjocklek = Slider(1300, range=0..1600)
platta_tass_höger = Slider(1500, range=0..10000)
addition_3 = Addition(A=platta_tjocklek, B=addition_2)
addition_4 = Addition(A=platta_tass_vänster, B=addition)
addition_5 = Addition(A=platta_tass_höger, B=addition)
addition_6 = Addition(A=tunneltak_tjocklek, B=tunnel_innerhöjd)
construct_point = ConstructPoint(XCoordinate=expr("-x", addition_4), YCoordinate=0, ZCoordinate=expr("-x", addition_3))
construct_point_2 = ConstructPoint(XCoordinate=addition_5, YCoordinate=0, ZCoordinate=expr("-x", addition_3))
construct_point_3 = ConstructPoint(XCoordinate=addition_4, YCoordinate=0, ZCoordinate=expr("-x", addition_2))
construct_point_4 = ConstructPoint(XCoordinate=expr("-x", addition_5), YCoordinate=0, ZCoordinate=expr("-x", addition_2))
unit_z = UnitZ(Factor=1)
merge = Merge(
    Data1=construct_point_3,
    Data2=construct_point_4,
    Data3=construct_point,
    Data4=construct_point_2,
    Data5=construct_point_3)
multiplication_4 = Multiplication(A=addition_6, B=unit_z)
polyline = PolyLine(Vertices=merge, Closed=False)
point_order = PointOrder(Points=merge)
panel_2 = Panel(multiplication_4)
move = Move(Geometry=polyline, Motion=multiplication_4)  # -> Geometry, Transform

# ---- group: Tak och väggpunkter
construct_point_5 = ConstructPoint(XCoordinate=0, YCoordinate=0, ZCoordinate=0)
construct_point_6 = ConstructPoint(XCoordinate=addition, YCoordinate=0, ZCoordinate=multiplication_3)
construct_point_7 = ConstructPoint(XCoordinate=expr("-x", division), YCoordinate=0, ZCoordinate=expr("-x", tunneltak_tjocklek))
construct_point_8 = ConstructPoint(XCoordinate=addition, YCoordinate=0, ZCoordinate=expr("-x", addition_2))
construct_point_9 = ConstructPoint(XCoordinate=division, YCoordinate=0, ZCoordinate=expr("-x", tunneltak_tjocklek))
construct_point_10 = ConstructPoint(XCoordinate=division, YCoordinate=0, ZCoordinate=expr("-x", addition_2))
construct_point_11 = ConstructPoint(XCoordinate=0, YCoordinate=0, ZCoordinate=expr("-x", tunneltak_tjocklek))
construct_point_12 = ConstructPoint(XCoordinate=expr("-x", division), YCoordinate=0, ZCoordinate=expr("-x", addition_2))
construct_point_13 = ConstructPoint(XCoordinate=expr("-x", addition), YCoordinate=0, ZCoordinate=expr("-x", addition_2))
construct_point_14 = ConstructPoint(XCoordinate=expr("-x", addition), YCoordinate=0, ZCoordinate=multiplication_3)

# ----
merge_2 = Merge(
    Data1=construct_point_5,
    Data2=construct_point_6,
    Data3=construct_point_8,
    Data4=construct_point_10,
    Data5=construct_point_9,
    Data6=construct_point_11,
    Data7=construct_point_7,
    Data8=construct_point_12,
    Data9=construct_point_13,
    Data10=construct_point_14,
    Data11=construct_point_5)

# ---- group: Tak och väggpunkter (continued)
point_order_2 = PointOrder(Points=merge_2)

# ---- group: Tunnel tvärsnit
addition_7 = Addition(A=tunneltak_tjocklek, B=tunnel_innerhöjd)
unit_z_2 = UnitZ(Factor=1)
polyline_2 = PolyLine(Vertices=merge_2, Closed=False)
multiplication_5 = Multiplication(A=addition_7, B=unit_z_2)
panel_3 = Panel(multiplication_5)
move_2 = Move(Geometry=polyline_2, Motion=multiplication_5)  # -> Geometry, Transform

# ---- group: Spårlinje
start_längdmätning = Slider(50000, range=0..121000)
slut_längdmätning = Slider(72500, range=0..121000)
curve = Curve(<curve referenced from the Rhino model>)
length = Length(Curve=curve)
unit_z_3 = UnitZ(Factor=1)
xz_plane = XZPlane(Origin=Point(0, 0, 0))

# ----
evaluate_length = EvaluateLength(Curve=curve, Length=start_längdmätning, Normalized=Toggle(False))  # -> Point, Tangent, Parameter
evaluate_length_2 = EvaluateLength(Curve=curve, Length=slut_längdmätning, Normalized=Toggle(False))  # -> Point, Tangent, Parameter
integer = Integer(length)

# ---- group: Spårlinje (continued)
panel_4 = Panel(integer)
construct_domain = ConstructDomain(DomainStart=evaluate_length.Parameter, DomainEnd=evaluate_length_2.Parameter)
sub_curve = SubCurve(BaseCurve=curve, Domain=construct_domain)
length_2 = Length(Curve=sub_curve)
integer_2 = Integer(length_2)
panel_5 = Panel(length_2)
panel_6 = Panel(integer_2)
division_3 = Division(A=integer_2, B="1000")
divide_curve = DivideCurve(Curve=sub_curve, Count=division_3, Kinks=False)  # -> Points, Tangents, Parameters
plane_normal = PlaneNormal(Origin=divide_curve.Points, ZAxis=divide_curve.Tangents)
align_plane = AlignPlane(Plane=plane_normal, Direction=unit_z_3)  # -> Plane, Angle
rotate_plane = RotatePlane(Plane=align_plane.Plane, Angle=degrees("-90"))

# ---- group: skapa solider
orient = Orient(Source=xz_plane, Target=rotate_plane)  # -> Geometry, Transform
transform = Transform(Geometry=move_2.Geometry, Transform=orient.Transform)
transform_2 = Transform(Geometry=move.Geometry, Transform=orient.Transform)
loft = Loft(Curves=transform, Options={Adjust=False, Closed=False, LoftEnds=0, LoftSimp=0, LoftType=0, Rebuild=10, Refit=0.01})
loft_2 = Loft(Curves=transform_2, Options={Adjust=False, Closed=False, LoftEnds=0, LoftSimp=0, LoftType=0, Rebuild=10, Refit=0.01})
cap_holes_ex = CapHolesEx(Brep=loft_2)  # -> Brep, Caps, Solid
cap_holes_ex_2 = CapHolesEx(Brep=loft)  # -> Brep, Caps, Solid
material = Material(<material referenced from the Revit model>)
material_2 = Material(<material referenced from the Revit model>)
category = Category(<category referenced from the Revit model>)
add_directshape_geometry = AddDirectShapeGeometry(Category=category, Geometry=cap_holes_ex_2.Brep, Material=material, TrackingMode=2)
add_directshape_geometry_2 = AddDirectShapeGeometry(Category=category, Geometry=cap_holes_ex.Brep, Material=material_2, TrackingMode=2)
custom_preview = CustomPreview(
    Geometry=cap_holes_ex.Brep,
    Material={diffuse=RGB(221, 160, 221), emission=RGB(66, 48, 66), shine=0.5, specular=RGB(255, 255, 255), transparency=0})
custom_preview_2 = CustomPreview(
    Geometry=cap_holes_ex_2.Brep,
    Material={diffuse=RGB(221, 160, 221), emission=RGB(66, 48, 66), shine=0.5, specular=RGB(255, 255, 255), transparency=0})
